% Simulink data dictionary DD_Mdl1.sldd

slBus1 = Simulink.Bus()
  wind_mpers: double
  GenSpd_radpers: double
  RotSpd_radpers: double
  ydotdot_mpers2: double
  xdotdot_mpers2: double
  zetadotdot_mpers2: double
  ThetaS_rad: double
  GenPwr_kW: double
  GenTq_Nm: double
  Pitch_rad: double

slBus2 = Simulink.Bus()
  RefBlPitch1: double
  RefBlPitch2: double
  RefBlPitch3: double
  RefGenTq: double

beta = [-0.03490659; -0.03141593; -0.02792527; -0.02443461; -0.02094395; -0.01745329; -0.01396263; -0.01047198; -0.006981317; -0.003490659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 0.4363323]

Ce = [17786.98 0 0 0 0
 0 1495597 0 0 0
 0 0 17128.2 0 0
 0 0 0 6215000 -6215000
 0 0 0 -6215000 6215000]

Cq = [0 0 0 0 0 0 0 0 0 0 0.003820565 0.003937772 0.004057484 0.004185885 0.004322963 0.004481831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
 0 0 0 0 0 0 0 0 0 0 0.003955389 0.004078175 0.004203471 0.004338239 0.004482038 0.004652063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
 0 0 0 0 0 0 0 0 0 0 0.004090129 0.004218107 0.004349205 0.004490342 0.004640808 0.004823202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
 0 0 0 0 0 0 0 0 0 0 0.004224797 0.004357224 0.004494155 0.004641619 0.004799309 0.004995022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
 0 0 0 0 0 0 0 0 0 0 0.004358726 0.004496273 0.004638935 0.004791869 0.004957504 0.005167375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
 0 0 0 0 0 0 0 0 0 0 0.00449218 0.004634337 0.004783355 0.004942018 0.005115301 0.005341073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
 0 0 0 0 0 0 0 0 0 0 0.004625694 0.004772416 0.004927424 0.005091782 0.005272429 0.005515521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
 0 0 0 0 0 0 0 0 0 0 0.004758966 0.004910474 0.005070665 0.005240984 0.005429512 0.005690866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
 0 0 0 0 0 0 0 0 0 0 0.004891401 0.005047881 0.00521352 0.0053895 0.00558685 0.005867962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
 0 0 0 0 0 0 0 0 0 0 0.005023755 0.005184481 0.00535592 0.005537397 0.005743481 0.006045666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 ]

Ct = [0 0 0 0 0 0 0 0 0 0 0.08361545 0.08668855 0.09000846 0.09340349 0.09686849 0.100566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
 0 0 0 0 0 0 0 0 0 0 0.08355772 0.08661666 0.08992033 0.09329398 0.09673536 0.1004209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
 0 0 0 0 0 0 0 0 0 0 0.08349865 0.08654233 0.08982766 0.09318067 0.09660152 0.100277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
 0 0 0 0 0 0 0 0 0 0 0.08343827 0.0864645 0.08973156 0.09306261 0.09646663 0.1001327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
 0 0 0 0 0 0 0 0 0 0 0.08337586 0.08638738 0.08963393 0.09294276 0.09632945 0.09998881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
 0 0 0 0 0 0 0 0 0 0 0.08330947 0.08637852 0.08953222 0.09282243 0.09619125 0.09988221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
 0 0 0 0 0 0 0 0 0 0 0.08324298 0.08629725 0.08942935 0.09270059 0.09605203 0.09973613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
 0 0 0 0 0 0 0 0 0 0 0.08317528 0.08621382 0.08932404 0.09257624 0.09591043 0.09959154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
 0 0 0 0 0 0 0 0 0 0 0.08310561 0.08612819 0.08921516 0.09244602 0.09576582 0.09943843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
 0 0 0 0 0 0 0 0 0 0 0.08303551 0.08603785 0.08910428 0.09231464 0.09561919 0.09929316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 ]

K5 = [1810494 0 0 0 -0
 0 6.881554e+08 0 0 -0
 0 0 1678867 0 -0
 0 0 0 867637000 -867637000
 0 0 0 -867637000 867637000]

lambda = [0; 0.1; 0.2; 0.3; 0.4; 0.5; 0.6; 0.7; 0.8; 0.9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 19.9]

M = [452831 754393.5 0 0 0
 754393.5 35645092.875 0 0 0
 0 0 436865 0 0
 0 0 0 38759000 0
 0 0 0 0 5025497.444]

Q = [1 0 0; 47.25 0 0; 0 0.007407407 -0.7185185; 0 1 0; 0 0 -97]
rho = 1.225

wecs = struct(
  N=3,
  Ng=97,
  mh=56780,
  mbl=17740,
  mb=5322,
  mn=240000,
  mtower=347460,
  mr=110000,
  mt=436865,
  mtb=452831,
  H=90,
  Jg=534.116,
  Jr=38759000,
  wnb=4.393831,
  wnt=2.035752,
  wntsw=1.960354,
  zetat=0.01,
  zetab=0.00477465,
  Kt=1810494,
  Bt=17786.98,
  Ktsw=1678867,
  Btsw=17128.2,
  Kb=102745.2,
  Bb=223.3006,
  Ks=867637000,
  Bs=6215000,
  Rr=63,
  rb=47.25,
  etag=0.944)